# Grasshopper definition 20160320_single_beam_geometry_definition.gh (Grasshopper 0.9.76)
# plug-ins: Python Interpreter, TMarsupilami, TMarsupilami.TestModel

N = Slider(22, range=0..100)

elongation = Slider(1, range=0.5..1.5)
theta_0 = Slider(0, range=-20..20)

shift_x_y = BooleanToggle(False)
b1 = Slider(0.2, range=0.01..0.5)
b2 = Slider(0.4, range=0..0.5)

list = ValueList({"symetric": 1, "antisymetric": -1}, selected="antisymetric")
a = Slider(10, range=5..20)
ouverture = Slider(60, range=0..90)
twist = Slider(30, range=-45..45)
twistmodulo = Slider(1, range=-2..2)

f1 = Slider(1, range=1..4)
f1_2 = Slider(1, range=1..4)
t = Slider(0, range=0..1)

# ----
# SECTIONS DEF
sections = PythonScript(shift=shift_x_y, b1=b1, b2=b2, f1=f1, f2=f1_2)  # -> P, R1, R2; inputs shift: Boolean
# ---------- sections: Python ----------
import Rhino.Geometry as rg

if shift:
    lx = b2
    ly = b1
    fx = f2
    fy = f1
    P = rg.Plane.WorldXY
else:
    lx = b1
    ly = b2
    fx = f1
    fy = f2
    P = rg.Plane.WorldXY

P1 = rg.Plane.WorldXY
P1.Origin = P1.Origin - (lx/2)*P1.XAxis - (ly/2)*P1.YAxis
R1 = rg.Rectangle3d(P1, lx, ly)

P2 = rg.Plane.WorldXY
P2.Origin = P2.Origin - (lx/(2*fx))*P2.XAxis - (ly/(2*fy))*P2.YAxis
 
R2 = rg.Rectangle3d(P2, lx/fx, ly/fy)


print lx
print ly
# ---------- end sections ----------
fdis = FrameDisplay(Frame=sections.P, ScaleFactor=2, LineWidth=[0, 3, 3], Color=[RGB(0, 0, 255), RGB(255, 0, 0), RGB(0, 255, 0)])
crv = Curve([sections.R1, sections.R2])

# ----
# INITIAL CONFIG
start_end_frames = StartEndFrames(initial_a=a, initial_ouverture=ouverture, initial_twist=twist, intial_symetric=list)  # -> fs, fe

_2ne = Integer(expr("2*x", N))
geom = DefineBeamGeometrySingle(StartFrame=start_end_frames.fs, EndFrame=start_end_frames.fe, EdgeCount=_2ne, TwistModulo=twistmodulo)  # -> BeamCenterline, Frames

# ----
# REST CONFIG
len = Length(Curve=geom.BeamCenterline)
multiplication = Multiplication(A=elongation, B=len)
cluster = Cluster_2(initial_a=multiplication)  # -> fs, fe

multiplication_2 = Multiplication(A=_2ne, B=t)
int = Integer(multiplication_2)
c_script = CSharpScript(
    N=_2ne,
    n=int,
    R1=sections.R1,
    R2=sections.R2,
    Reference=["Z:\Github\TMarsupilami2\src\TMarsupilami.Gh\bin\TMarsupilami.MathLib.dll", "Z:\Github\TMarsupilami2\src\TMarsupilami.Gh\bin\TMarsupilami.Gh.dll"])  # -> out, bx, by; inputs N: Int32, n: Int32, R1: Rectangle3d, R2: Rectangle3d
# ---------- c_script: C# ----------
    double[] b1, b2;
    b1 = new double[N];
    b2 = new double[N];

    if (n < 1)
    {
      for (int i = 0; i < N; i++)
      {
        b1[i] = R2.Width;
        b2[i] = R2.Height;
      }
    }
    else if (n > N+1)
    {
      for (int i = 0; i < N+1; i++)
      {
        b1[i] = R1.Width;
        b2[i] = R1.Height;
      }
    }
    else
    {
      for (int i = 0; i < n; i++)
      {
        b1[i] = R1.Width;
        b2[i] = R1.Height;
      }
      for (int i = n; i < N; i++)
      {
        b1[i] = R2.Width;
        b2[i] = R2.Height;
      }
    }



    // output
    bx = b1;
    by = b2;
# ---------- end c_script ----------

geom_2 = DefineBeamGeometrySingle(StartFrame=cluster.fs, EndFrame=cluster.fe, EdgeCount=_2ne, TwistModulo=0)  # -> BeamCenterline, Frames
rz = ZRotateAFrame(FrameS=geom_2.Frames, ZTwistAngleS=theta_0)

crv_2 = Curve(geom_2.BeamCenterline)
mframe = Frame(rz)

crv_3 = Curve(geom.BeamCenterline)
mframe_2 = Frame(geom.Frames)

# ---- group: Display Frames
cull_i = CullIndex(List=mframe, Indices=[0, -1], Wrap=True)
item = ListItem(List=mframe, Index=[0, -1], Wrap=True)
fdis_2 = FrameDisplay(Frame=cull_i, ScaleFactor=1, LineWidth=[2, 1, 1], Color=[RGB(0, 0, 255), RGB(255, 0, 0), RGB(0, 255, 0)])
fdis_3 = FrameDisplay(Frame=item, ScaleFactor=4, LineWidth=3, Color=[RGB(0, 0, 255), RGB(255, 0, 0), RGB(0, 255, 0)])

# ---- group: Display Brep
c_script_2 = CSharpScript(
    centerline=crv_2,
    F=mframe,
    n=int,
    P=sections.P,
    R1=sections.R1,
    R2=sections.R2,
    Reference=["Z:\Github\TMarsupilami2\src\TMarsupilami.Gh\bin\TMarsupilami.MathLib.dll", "Z:\Github\TMarsupilami2\src\TMarsupilami.Gh\bin\TMarsupilami.Gh.dll"])  # -> out, C, S, B; inputs centerline: Curve, F: list, n: Int32, P: Plane, R1: Rectangle3d, R2: Rectangle3d
# ---------- c_script_2: C# ----------
    MFrame[ ] f1, f2;
    Curve c1, c2;
    Curve[] s1, s2;
    Brep b1, b2;

    var sweep = new Rhino.Geometry.SweepOneRail();
    sweep.MiterType = 0;
    sweep.GlobalShapeBlending = false;

    var sweep2 = new Rhino.Geometry.SweepTwoRail();

    if (n < 1)
    {
      f1 = new MFrame[0];
      f2 = new MFrame[F.Count];
      for (int i = 0; i < F.Count; i++)
      {
        f2[i] = (MFrame) F[i];
      }
      c1 = null;
      c2 = centerline;
    }
    else if (n > F.Count)
    {
      f2 = new MFrame[0];
      f1 = new MFrame[F.Count];
      for (int i = 0; i < F.Count; i++)
      {
        f1[i] = (MFrame) F[i];
      }
      c1 = centerline;
      c2 = null;
    }
    else
    {
      f1 = new MFrame[n];
      for (int i = 0; i < f1.Length; i++)
      {
        f1[i] = (MFrame) F[i];
      }
      f2 = new MFrame[F.Count - n + 1];
      for (int i = 0; i < f2.Length; i++)
      {
        f2[i] = (MFrame) F[n - 1 + i];
      }

      // changing point
      double param;
      var point = f1[n - 1].Origin.Cast();
      centerline.ClosestPoint(point, out param);
      var subCurves = centerline.Split(param);
      c1 = subCurves[0];
      c2 = subCurves[1];
    }

    var c = new List<Curve>();
    var s = new List<Curve>();
    var f = new List<MFrame>();
    var b = new List<Brep>();

    // Sweep over C1
    if (c1 != null)
    {
      var pts = new Point3d[f1.Length];
      s1 = new Rhino.Geometry.Curve[f1.Length];
      for (int i = 0; i < f1.Length; i++)
      {
        var xform = Transform.PlaneToPlane(P, f1[i].Cast());
        var polyline = R1.ToPolyline();
        polyline.Transform(xform);
        s1[i] = new Rhino.Geometry.PolylineCurve(polyline);
        pts[i] = polyline[0];
      }
      var rail_ext = Rhino.Geometry.Curve.CreateInterpolatedCurve(pts, 3);
      var rail_int = c1;
      b1 = sweep2.PerformSweep(rail_int, rail_ext, s1)[0];

      var cap_1 = Rhino.Geometry.Brep.CreatePlanarBreps(s1[0])[0];
      var cap_2 = Rhino.Geometry.Brep.CreatePlanarBreps(s1[f1.Length - 1])[0];
      b1 = Brep.JoinBreps(new Brep[3]{cap_1, b1, cap_2}, 1e-9)[0];

      c.Add(c1);
      s.AddRange(s1);
      b.Add(b1);
    }
    if (c2 != null)
    {
      var pts = new Point3d[f2.Length];
      s2 = new Rhino.Geometry.Curve[f2.Length];
      for (int i = 0; i < f2.Length; i++)
      {
        var xform = Transform.PlaneToPlane(P, f2[i].Cast());
        var polyline = R2.ToPolyline();
        polyline.Transform(xform);
        s2[i] = new Rhino.Geometry.PolylineCurve(polyline);
        pts[i] = polyline[0];
      }
      var rail_ext = Rhino.Geometry.Curve.CreateInterpolatedCurve(pts, 3);
      var rail_int = c2;
      b2 = sweep2.PerformSweep(rail_int, rail_ext, s2)[0];

      var cap_1 = Rhino.Geometry.Brep.CreatePlanarBreps(s2[0])[0];
      var cap_2 = Rhino.Geometry.Brep.CreatePlanarBreps(s2[f2.Length - 1])[0];
      b2 = Brep.JoinBreps(new Brep[3]{cap_1, b2, cap_2}, 1e-9)[0];

      c.Add(c2);
      s.AddRange(s2);
      b.Add(b2);
    }

    // output
    C = c;
    S = s;
    B = b;
# ---------- end c_script_2 ----------
crv_4 = Curve(c_script_2.C)
crv_5 = Curve(c_script_2.S)
brep = Brep(c_script_2.B)
preview = CustomPreview(Geometry=brep, Shader=ColourSwatch(SwatchColor=RGB(10, 133, 255)))

# ---- group: Display Frames
cull_i_2 = CullIndex(List=mframe_2, Indices=[0, -1], Wrap=True)
item_2 = ListItem(List=mframe_2, Index=[0, -1], Wrap=True)
fdis_4 = FrameDisplay(Frame=cull_i_2, ScaleFactor=1, LineWidth=[2, 1, 1], Color=[RGB(0, 0, 255), RGB(255, 0, 0), RGB(0, 255, 0)])
fdis_5 = FrameDisplay(Frame=item_2, ScaleFactor=4, LineWidth=3, Color=[RGB(0, 0, 255), RGB(255, 0, 0), RGB(0, 255, 0)])

# ---- group: Display Brep
c_script_3 = CSharpScript(
    centerline=crv_3,
    F=mframe_2,
    n=int,
    P=sections.P,
    R1=sections.R1,
    R2=sections.R2,
    Reference=["Z:\Github\TMarsupilami2\src\TMarsupilami.Gh\bin\TMarsupilami.MathLib.dll", "Z:\Github\TMarsupilami2\src\TMarsupilami.Gh\bin\TMarsupilami.Gh.dll"])  # -> out, C, S, B; inputs centerline: Curve, F: list, n: Int32, P: Plane, R1: Rectangle3d, R2: Rectangle3d; same code as c_script_2
crv_6 = Curve(c_script_3.C)
crv_7 = Curve(c_script_3.S)
brep_2 = Brep(c_script_3.B)
preview_2 = CustomPreview(Geometry=brep_2, Shader=ColourSwatch(SwatchColor=RGB(255, 255, 255)))

# ----
rad = Radians(Degrees=Slider(9, range=0..10))
crv_8 = Curve(<curve referenced from the Rhino model>)
curvature = Curvature(Curve=crv_8, Parameter=0)  # -> P, K, C
pframes = PerpFrames(Curve=crv_8, Count=30, Align=True)  # -> Frames, Parameters
lng = ListLength(List=pframes.Frames)
series = Series(Start=0, Step=rad, Count=lng)
Z = UnitZ(Factor=-0.5)
move = Move(Geometry=pframes.Frames, Motion=Z)  # -> Geometry, Transform
mframe_3 = Frame(pframes.Frames)
rz_2 = ZRotateAFrame(FrameS=pframes.Frames, ZTwistAngleS=series)
toggle = BooleanToggle(True)
points = PointList(Points=move.Geometry, Size=0.2)
mframe_4 = Frame(rz_2)
item_3 = ListItem(List=mframe_3, Index=0, Wrap=True)
fdis_6 = FrameDisplay(Frame=mframe_4, ScaleFactor=1, LineWidth=[2, 1, 1], Color=[RGB(0, 0, 255), RGB(255, 0, 0), RGB(0, 255, 0)])
interpolate = InterpolateFramesCircumbscribedRotation(Frames=mframe_4, Closed=toggle, RecursionCount=Slider(5, range=0..6))
interpolate_2 = InterpolateFramesCircumbscribedRotation(Frames=mframe_4, Closed=toggle, RecursionCount=1)
item_4 = ListItem(Index=Slider(18, range=0..20), Wrap=True)
interpolate_3 = InterpolateFramesCircumbscribedRotation(Frames=interpolate_2, Closed=toggle, RecursionCount=1)
fdis_7 = FrameDisplay(Frame=interpolate, ScaleFactor=0.25, LineWidth=[2, 1, 1], Color=[RGB(0, 0, 255), RGB(255, 0, 0), RGB(0, 255, 0)])
interpolate_4 = InterpolateFramesCircumbscribedRotation(Frames=interpolate_3, Closed=toggle, RecursionCount=1)
fdis_8 = FrameDisplay(Frame=interpolate_4, ScaleFactor=0.25, LineWidth=[2, 1, 1], Color=[RGB(0, 0, 255), RGB(255, 0, 0), RGB(0, 255, 0)])
centerline_circ_rot = CenterlinePropertiesCircumbscribedRotation(Frame=interpolate, Closed=toggle)  # -> Centerline, Frames, Curvature, Twist

# ---- group: Beam A
sections_0 = Plane(rz)
sections_i = Plane(mframe_2)
section_b1 = Number(c_script.bx)
section_b2 = Number(c_script.by)

# ----
cull = CullPattern(List=section_b1, CullPattern=[True, False])
cull_2 = CullPattern(List=section_b2, CullPattern=[True, False])
cull_3 = CullPattern(List=sections_0, CullPattern=[True, False])
cull_4 = CullPattern(List=sections_i, CullPattern=[True, False])
sections_0_2 = Plane(cull_3)
sections_i_2 = Plane(cull_4)
section_b2_2 = Number(cull_2)
section_b1_2 = Number(cull)

list_2 = ValueList({"FREE": 0, "PIN": 1, "CLAMPED": 2}, selected="CLAMPED")
list_3 = ValueList({"FREE": 0, "PIN": 1, "CLAMPED": 2}, selected="CLAMPED")
panel = Panel("10000")
_4_dof_disc = _4DOFWithDiscSimpleBeam(
    RestPosition=sections_0,
    InitialPosition=sections_i,
    SectionB1=section_b1,
    SectionB2=section_b2,
    BoundaryConditionAtStart=list_2,
    BoundaryConditionAtEnd=list_3,
    Iteration_max="50000",
    Reset=Button(),
    IsBase=True)  # -> info, index, l_0, kb_0, k1_0, k2_0, twist_0, tau_0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
panel_2 = Panel(_4_dof_disc.info)
simple_beam_2 = SimpleBeam2(
    RestPosition=sections_0,
    InitialPosition=sections_i,
    SectionB1=section_b1,
    SectionB2=section_b2,
    BoundaryConditionAtStart=list_2,
    BoundaryConditionAtEnd=list_3,
    Iteration_max="50000",
    Reset=Button(),
    IsBase=True)  # -> info, index, l_0, kb_0, k1_0, k2_0, twist_0, tau_0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; disabled
_4_dof_disc_2 = _4DOFWithDiscSimpleBeam(
    RestPosition=sections_0,
    InitialPosition=sections_i,
    SectionB1=section_b1,
    SectionB2=section_b2,
    BoundaryConditionAtStart=list_2,
    BoundaryConditionAtEnd=list_3,
    Iteration_max="50000",
    Reset=Button(),
    IsBase=True)  # -> info, index, l_0, kb_0, k1_0, k2_0, twist_0, tau_0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
_4_dof_disc_skdr2 = _4_DOF_DISC_SKDR2(
    RestPosition=sections_0,
    InitialPosition=sections_i,
    SectionB1=section_b1,
    SectionB2=section_b2,
    BoundaryConditionAtStart=list_2,
    BoundaryConditionAtEnd=list_3,
    Iteration_max="50000",
    Reset=Button(),
    IsBase=True)  # -> info, index, l_0, kb_0, k1_0, k2_0, twist_0, tau_0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
_4_dof_disc_skdr = _4_DOF_DISC_SKDR(
    RestPosition=sections_0_2,
    InitialPosition=sections_i_2,
    SectionB1=section_b1_2,
    SectionB2=section_b2_2,
    BoundaryConditionAtStart=list_2,
    BoundaryConditionAtEnd=list_3,
    Iteration_max="25000",
    Reset=Button(),
    IsBase=True)
deg = Degrees(Radians=_4_dof_disc.twist)

rest = BooleanToggle(True)
N_2 = BeamDiagram(Beam=_4_dof_disc_skdr, Scale="1e-5", RestActual=rest)  # -> Nr, Nl, Nmid, D
preview_3 = CustomPreview(Geometry=N_2.D, Shader=ColourSwatch(SwatchColor=RGB(255, 255, 255)))

rest_2 = BooleanToggle(True)
M = BeamM(Beam=_4_dof_disc_skdr, Scale="1e-5", RestActual=rest_2)  # -> Mr, Ml, D1, D2
preview_4 = CustomPreview(Geometry=[M.D1, M.D2], Shader=ColourSwatch(SwatchColor=RGB(255, 0, 0)))

rest_3 = BooleanToggle(False)
V = BeamV(Beam=_4_dof_disc_skdr, Scale="1e-5", RestActual=rest_3)  # -> Vr, Vl, Vmid, D1, D2
preview_5 = CustomPreview(Geometry=[V.D1, V.D2], Shader=ColourSwatch(SwatchColor=RGB(55, 255, 0)))

rest_4 = BooleanToggle(True)
Q = BeamQ(Beam=_4_dof_disc_skdr, Scale="1e-5", RestActual=rest_4)  # -> Qr, Ql, Qmid, D
preview_6 = CustomPreview(Geometry=Q.D, Shader=ColourSwatch(SwatchColor=RGB(237, 230, 28)))

num = Number(_4_dof_disc.t)
mframe_5 = Frame(simple_beam_2.sections)
bdis = BeamInternals(Beam=_4_dof_disc_skdr)  # -> Frames, FramesMid, FextG, MextL, FextG_2, MextL_2, FrG, MrL
deplane = DeconstructPlane(Plane=_4_dof_disc.sections)  # -> Origin, XAxis, YAxis, ZAxis
centerline_circ_rot_2 = CenterlinePropertiesCircumbscribedRotation(Frame=mframe_4, Closed=toggle)  # -> Centerline, Frames, Curvature, Twist
pln = Plane(_4_dof_disc.sections)
mframe_6 = Frame(pln)
θz = ZTwistAngleBetweenFramesRotation(Frames=mframe_6)
deplane_2 = DeconstructPlane(Plane=simple_beam_2.sections)  # -> Origin, XAxis, YAxis, ZAxis
pln_2 = Plane(simple_beam_2.sections)
θz_2 = ZTwistAngleBetweenFramesRotation(Frames=mframe_5)
θz_3 = ZTwistAngleBetweenFramesReflection(Frames=mframe_5)
pln_3 = Plane(_4_dof_disc_2.sections)
pt = Point(pln)
pln_4 = Plane(_4_dof_disc_skdr2.sections)
pt_2 = Point(pln_2)
pt_3 = Point(pln_3)
num_2 = Number(deplane.ZAxis)
fdis_9 = FrameDisplay(Frame=bdis.FramesMid, ScaleFactor=0.5, LineWidth=[2, 1, 1], Color=[RGB(0, 0, 255), RGB(255, 0, 0), RGB(0, 255, 0)])
intcrv = Interpolate(Vertices=pt, Degree=3, Periodic=False, KnotStyle=1)  # -> Curve, Length, Domain
intcrv_2 = Interpolate(Vertices=pt_2, Degree=3, Periodic=False, KnotStyle=1)  # -> Curve, Length, Domain
pt_4 = Point(pln_4)
pline = PolyLine(Vertices=pt, Closed=False)
pt_5 = Point(bdis.Frames)
intcrv_3 = Interpolate(Vertices=pt_3, Degree=3, Periodic=False, KnotStyle=1)  # -> Curve, Length, Domain
pline_2 = PolyLine(Vertices=sections_0, Closed=False)
vdis = VectorDisplay(Anchor=centerline_circ_rot_2.Frames, Vector=expr("10*x", centerline_circ_rot_2.Curvature))
crv_9 = Curve(centerline_circ_rot_2.Centerline)
intcrv_4 = Interpolate(Vertices=pt_4, Degree=3, Periodic=False, KnotStyle=1)  # -> Curve, Length, Domain

crv_10 = Curve(intcrv.Curve)
mframe_7 = Frame(pln)

panel_3 = Panel(num_2)
pline_3 = PolyLine(Vertices=pt_5, Closed=False)
len_2 = Length(Curve=pline_3)
intcrv_5 = Interpolate(Vertices=pt_5, Degree=3, Periodic=False, KnotStyle=1)  # -> Curve, Length, Domain
m_disp = MomentDisplayConcentratedM(ConcentratedMoment=Q.Qmid, Project=True, CoordinateSystem=False, Scale="1e-5")
fdis_10 = FrameDisplay(
    Frame=centerline_circ_rot_2.Frames,
    ScaleFactor=1,
    LineWidth=[2, 1, 1],
    Color=[RGB(0, 0, 255), RGB(255, 0, 0), RGB(0, 255, 0)])

crv_11 = Curve(intcrv_2.Curve)
mframe_8 = Frame(pln_2)

crv_12 = Curve(intcrv_3.Curve)
mframe_9 = Frame(pln_3)

len_3 = Length(Curve=pline_2)

crv_13 = Curve(intcrv_4.Curve)
mframe_10 = Frame(pln_4)

crv_14 = Curve(intcrv_5.Curve)
mframe_11 = Frame(bdis.Frames)

# ---- group: Display Frames
cull_i_3 = CullIndex(List=mframe_7, Indices=[0, -1], Wrap=True)
item_5 = ListItem(List=mframe_7, Index=[0, -1], Wrap=True)
fdis_11 = FrameDisplay(Frame=cull_i_3, ScaleFactor=1, LineWidth=[2, 1, 1], Color=[RGB(0, 0, 255), RGB(255, 0, 0), RGB(0, 255, 0)])
fdis_12 = FrameDisplay(Frame=item_5, ScaleFactor=4, LineWidth=3, Color=[RGB(0, 0, 255), RGB(255, 0, 0), RGB(0, 255, 0)])

# ---- group: Display Brep
c_script_4 = CSharpScript(
    centerline=crv_10,
    F=mframe_7,
    n=int,
    P=sections.P,
    R1=sections.R1,
    R2=sections.R2,
    Reference=["Z:\Github\TMarsupilami2\src\TMarsupilami.Gh\bin\TMarsupilami.MathLib.dll", "Z:\Github\TMarsupilami2\src\TMarsupilami.Gh\bin\TMarsupilami.Gh.dll"])  # -> out, C, S, B; inputs centerline: Curve, F: list, n: Int32, P: Plane, R1: Rectangle3d, R2: Rectangle3d; same code as c_script_2
crv_15 = Curve(c_script_4.C)
crv_16 = Curve(c_script_4.S)
brep_3 = Brep(c_script_4.B)
preview_7 = CustomPreview(Geometry=brep_3, Shader=ColourSwatch(SwatchColor=RGB(10, 133, 255)))

# ----
num_3 = Number([bdis.FrG, bdis.MrL])
explode = Explode(Curve=crv_9, Recursive=True)  # -> Segments, Vertices
num_4 = Number([bdis.FextG_2, bdis.MextL_2])

# ---- group: Display Frames
cull_i_4 = CullIndex(List=mframe_8, Indices=[0, -1], Wrap=True)
item_6 = ListItem(List=mframe_8, Index=[0, -1], Wrap=True)
fdis_13 = FrameDisplay(Frame=cull_i_4, ScaleFactor=1, LineWidth=[2, 1, 1], Color=RGB(217, 0, 255))
fdis_14 = FrameDisplay(Frame=item_6, ScaleFactor=4, LineWidth=3, Color=[RGB(0, 0, 255), RGB(255, 0, 0), RGB(0, 255, 0)])

# ---- group: Display Brep
c_script_5 = CSharpScript(
    centerline=crv_11,
    F=mframe_8,
    n=int,
    P=sections.P,
    R1=sections.R1,
    R2=sections.R2,
    Reference=["Z:\Github\TMarsupilami2\src\TMarsupilami.Gh\bin\TMarsupilami.MathLib.dll", "Z:\Github\TMarsupilami2\src\TMarsupilami.Gh\bin\TMarsupilami.Gh.dll"])  # -> out, C, S, B; inputs centerline: Curve, F: list, n: Int32, P: Plane, R1: Rectangle3d, R2: Rectangle3d; same code as c_script_2
crv_17 = Curve(c_script_5.C)
crv_18 = Curve(c_script_5.S)
brep_4 = Brep(c_script_5.B)
preview_8 = CustomPreview(Geometry=brep_4, Shader=ColourSwatch(SwatchColor=RGB(10, 133, 255)))

# ---- group: Display Frames
cull_i_5 = CullIndex(List=mframe_9, Indices=[0, -1], Wrap=True)
item_7 = ListItem(List=mframe_9, Index=[0, -1], Wrap=True)
fdis_15 = FrameDisplay(Frame=cull_i_5, ScaleFactor=1, LineWidth=[2, 1, 1], Color=[RGB(0, 0, 255), RGB(255, 0, 0), RGB(0, 255, 0)])
fdis_16 = FrameDisplay(Frame=item_7, ScaleFactor=4, LineWidth=3, Color=[RGB(0, 0, 255), RGB(255, 0, 0), RGB(0, 255, 0)])

# ---- group: Display Brep
c_script_6 = CSharpScript(
    centerline=crv_12,
    F=mframe_9,
    n=int,
    P=sections.P,
    R1=sections.R1,
    R2=sections.R2,
    Reference=["Z:\Github\TMarsupilami2\src\TMarsupilami.Gh\bin\TMarsupilami.MathLib.dll", "Z:\Github\TMarsupilami2\src\TMarsupilami.Gh\bin\TMarsupilami.Gh.dll"])  # -> out, C, S, B; inputs centerline: Curve, F: list, n: Int32, P: Plane, R1: Rectangle3d, R2: Rectangle3d; same code as c_script_2
crv_19 = Curve(c_script_6.C)
crv_20 = Curve(c_script_6.S)
brep_5 = Brep(c_script_6.B)
preview_9 = CustomPreview(Geometry=brep_5, Shader=ColourSwatch(SwatchColor=RGB(10, 255, 22)))

# ----
bnd = Bounds(Numbers=num_3)
bnd_2 = Bounds(Numbers=num_4)

# ---- group: Display Frames
cull_i_6 = CullIndex(List=mframe_10, Indices=[0, -1], Wrap=True)
item_8 = ListItem(List=mframe_10, Index=[0, -1], Wrap=True)
fdis_17 = FrameDisplay(Frame=cull_i_6, ScaleFactor=1, LineWidth=[2, 1, 1], Color=[RGB(0, 0, 255), RGB(255, 0, 0), RGB(0, 255, 0)])
fdis_18 = FrameDisplay(Frame=item_8, ScaleFactor=4, LineWidth=3, Color=[RGB(0, 0, 255), RGB(255, 0, 0), RGB(0, 255, 0)])

# ---- group: Display Brep
c_script_7 = CSharpScript(
    centerline=crv_13,
    F=mframe_10,
    n=int,
    P=sections.P,
    R1=sections.R1,
    R2=sections.R2,
    Reference=["Z:\Github\TMarsupilami2\src\TMarsupilami.Gh\bin\TMarsupilami.MathLib.dll", "Z:\Github\TMarsupilami2\src\TMarsupilami.Gh\bin\TMarsupilami.Gh.dll"])  # -> out, C, S, B; inputs centerline: Curve, F: list, n: Int32, P: Plane, R1: Rectangle3d, R2: Rectangle3d; same code as c_script_2
crv_21 = Curve(c_script_7.C)
crv_22 = Curve(c_script_7.S)
brep_6 = Brep(c_script_7.B)
preview_10 = CustomPreview(Geometry=brep_6, Shader=ColourSwatch(SwatchColor=RGB(255, 247, 10)))

# ---- group: Display Frames
cull_i_7 = CullIndex(List=mframe_11, Indices=[0, -1], Wrap=True)
item_9 = ListItem(List=mframe_11, Index=[0, -1], Wrap=True)
fdis_19 = FrameDisplay(Frame=cull_i_7, ScaleFactor=1, LineWidth=[2, 1, 1], Color=[RGB(0, 0, 255), RGB(255, 0, 0), RGB(0, 255, 0)])
fdis_20 = FrameDisplay(Frame=item_9, ScaleFactor=4, LineWidth=3, Color=[RGB(0, 0, 255), RGB(255, 0, 0), RGB(0, 255, 0)])

# ----
pln_5 = Plane(item_9)

# ---- group: Display Brep
c_script_8 = CSharpScript(
    centerline=crv_14,
    F=mframe_11,
    n=int,
    P=sections.P,
    R1=sections.R1,
    R2=sections.R2,
    Reference=["Z:\Github\TMarsupilami2\src\TMarsupilami.Gh\bin\TMarsupilami.MathLib.dll", "Z:\Github\TMarsupilami2\src\TMarsupilami.Gh\bin\TMarsupilami.Gh.dll"])  # -> out, C, S, B; inputs centerline: Curve, F: list, n: Int32, P: Plane, R1: Rectangle3d, R2: Rectangle3d; same code as c_script_2
crv_23 = Curve(c_script_8.C)
crv_24 = Curve(c_script_8.S)
brep_7 = Brep(c_script_8.B)
preview_11 = CustomPreview(Geometry=brep_7, Shader=ColourSwatch(SwatchColor=RGB(255, 247, 10)))

# ----
dedomain = DeconstructDomain(Domain=bnd)  # -> Start, End
list_4 = ValueList({"0", "1", "2", "3", "4", "5", "6", "7", "8", "9", "10", "11", "12", "13", "14", "15", "16", "17", "18", "19", "20", "21", "22", "23", "24", "25", "26"}, selected="9")
filter = StreamFilter(
    Gate=list_4,
    Stream0=simple_beam_2.kb_g,
    Stream1=simple_beam_2.kb_h_l,
    Stream2=simple_beam_2.kb_h_r,
    Stream3=simple_beam_2.twist,
    Stream4=simple_beam_2.τ,
    Stream5=simple_beam_2.Mr,
    Stream6=simple_beam_2.M_g,
    Stream7=simple_beam_2.M_h_l,
    Stream8=simple_beam_2.M_h_r,
    Stream9=simple_beam_2.Q,
    Stream10=simple_beam_2.Q_l,
    Stream11=simple_beam_2.Q_r,
    Stream12=simple_beam_2.V_M_g,
    Stream13=simple_beam_2.V_M_h_l,
    Stream14=simple_beam_2.V_M_h_r,
    Stream15=simple_beam_2.N,
    Stream16=simple_beam_2.N_l,
    Stream17=simple_beam_2.N_r,
    Stream18=simple_beam_2.Rx_axial,
    Stream19=simple_beam_2.Rx_shear_M,
    Stream20=simple_beam_2.Rx_shear_Q,
    Stream21=simple_beam_2.Rθ_M,
    Stream22=simple_beam_2.Rθ_Q,
    Stream23=simple_beam_2.lm_x,
    Stream24=simple_beam_2.lm_θ,
    Stream25=simple_beam_2.v_x,
    Stream26=simple_beam_2.v_θ)
filter_2 = StreamFilter(
    Gate=list_4,
    Stream0=_4_dof_disc.kb_g,
    Stream1=_4_dof_disc.kb_h_l,
    Stream2=_4_dof_disc.kb_h_r,
    Stream3=_4_dof_disc.twist,
    Stream4=_4_dof_disc.τ,
    Stream5=_4_dof_disc.Mr,
    Stream6=_4_dof_disc.M_g,
    Stream7=_4_dof_disc.M_h_l,
    Stream8=_4_dof_disc.M_h_r,
    Stream9=_4_dof_disc.Q,
    Stream10=_4_dof_disc.Q_l,
    Stream11=_4_dof_disc.Q_r,
    Stream12=_4_dof_disc.V_M_g,
    Stream13=_4_dof_disc.V_M_h_l,
    Stream14=_4_dof_disc.V_M_h_r,
    Stream15=_4_dof_disc.N,
    Stream16=_4_dof_disc.N_l,
    Stream17=_4_dof_disc.N_r,
    Stream18=_4_dof_disc.Rx_axial,
    Stream19=_4_dof_disc.Rx_shear_M,
    Stream20=_4_dof_disc.Rx_shear_Q,
    Stream21=_4_dof_disc.Rθ_M,
    Stream22=_4_dof_disc.Rθ_Q,
    Stream23=_4_dof_disc.lm_x,
    Stream24=_4_dof_disc.lm_θ,
    Stream25=_4_dof_disc.v_x,
    Stream26=_4_dof_disc.v_θ)
data = Data(filter)
data_2 = Data(filter_2)
dedomain_2 = DeconstructDomain(Domain=bnd_2)  # -> Start, End
subtraction = Subtraction(A=data_2, B=data)
deplane_3 = DeconstructPlane(Plane=pln_5)  # -> Origin, XAxis, YAxis, ZAxis
division = Division(A=Slider(6, range=0..10), B=dedomain.End)
explode_2 = BooleanToggle(True)
cs = ValueList({"Global": True, "Local": False}, selected="Local")
division_2 = Division(A=Slider(2, range=0..10), B=dedomain_2.End)
num_5 = Number(subtraction)
num_6 = Number(data)
division_3 = Division(A=num_5, B=num_6)
f_disp = ForceDisplayConcentratedF(ConcentratedForce=[bdis.FrG, bdis.FextG], Project=False, CoordinateSystem=True, Scale=division)
m_disp_2 = MomentDisplayConcentratedM(ConcentratedMoment=[bdis.MrL, bdis.MextL], Project=False, CoordinateSystem=True, Scale=division)
f_disp_2 = ForceDisplayDistributedF(DistributedForce=bdis.FextG_2, Project=explode_2, CoordinateSystem=cs, Scale=division_2)
m_disp_3 = MomentDisplayDistributedM(DistributedMoment=bdis.MextL_2, Project=explode_2, CoordinateSystem=cs, Scale=division_2)
abs = Absolute(Value=division_3)
list_5 = ValueList({"0", "1", "2", "3"}, selected="1")
filter_3 = StreamFilter(Gate=list_5, Stream0=deplane.Origin, Stream1=deplane.XAxis, Stream2=deplane.YAxis, Stream3=deplane.ZAxis)
filter_4 = StreamFilter(Gate=list_5, Stream0=deplane_2.Origin, Stream1=deplane_2.XAxis, Stream2=deplane_2.YAxis, Stream3=deplane_2.ZAxis)
data_3 = Data(filter_4)
data_4 = Data(filter_3)
subtraction_2 = Subtraction(A=data_4, B=data_3)
num_7 = Number(subtraction_2)
num_8 = Number(data_3)
division_4 = Division(A=num_7, B=num_8)
abs_2 = Absolute(Value=division_4)
panel_4 = Panel(abs)
panel_5 = Panel(abs_2)
panel_6 = Panel(data_2)
panel_7 = Panel(data_4)
panel_8 = Panel(data_3)
panel_9 = Panel(data)

# ==== cluster StartEndFrames
initial_a = ClusterInput()
initial_ouverture = ClusterInput()
initial_twist = ClusterInput()
intial_symetric = ClusterInput()
initial_ouverture_2 = Number(initial_ouverture)
intial_symetric_2 = Integer(intial_symetric)
initial_twist_2 = Number(initial_twist)
initial_a_2 = Number(initial_a)
cluster = Cluster(X=initial_a_2, Z=0)  # -> pt_6, pt_4, pt_5

# ---- group: CONFIG : START / OUVERTURE
angle = Number(initial_ouverture_2)
pt = Point(cluster.pt_6)
pt_2 = Point(cluster.pt_5)
pl = ConstructPlane(Origin=pt, XAxis=expr("{0,0,1}", Vector(78.26149335, 0, 0)), YAxis=expr("{0,-1,0}", Vector(0, 1, 0)))
pl_2 = ConstructPlane(Origin=pt_2, XAxis=expr("{0,0,1}", Vector(78.26149335, 0, 0)), YAxis=expr("{0,-1,0}", Vector(0, 1, 0)))
deplane = DeconstructPlane(Plane=pl)  # -> Origin, XAxis, YAxis, ZAxis
deplane_2 = DeconstructPlane(Plane=pl_2)  # -> Origin, XAxis, YAxis, ZAxis
rot3d = Rotate3D(Geometry=pl_2, Angle=expr("-x", degrees(angle)), Center=deplane_2.Origin, Axis=deplane_2.YAxis)  # -> Geometry, Transform
rot3d_2 = Rotate3D(Geometry=pl, Angle=degrees(angle), Center=deplane.Origin, Axis=deplane.YAxis)  # -> Geometry, Transform

# ---- group: CONFIG : START / TWIST
angle_2 = Number(initial_twist_2)
pln = Plane(rot3d.Geometry)
pln_2 = Plane(rot3d_2.Geometry)
deplane_3 = DeconstructPlane(Plane=pln_2)  # -> Origin, XAxis, YAxis, ZAxis
deplane_4 = DeconstructPlane(Plane=pln)  # -> Origin, XAxis, YAxis, ZAxis
multiplication = Multiplication(A=angle_2, B=intial_symetric_2)
rot3d_3 = Rotate3D(Geometry=pln, Angle=expr("-x", degrees(multiplication)), Center=deplane_4.Origin, Axis=expr("{0,0,1}", Vector(0, 0, 1)))  # -> Geometry, Transform
rot3d_4 = Rotate3D(Geometry=pln_2, Angle=degrees(angle_2), Center=deplane_3.Origin, Axis=expr("{0,0,1}", Vector(0, 0, 1)))  # -> Geometry, Transform

# ----
mframe = Frame(rot3d_3.Geometry)
mframe_2 = Frame(rot3d_4.Geometry)
fe = ClusterOutput(mframe)
fs = ClusterOutput(mframe_2)

# ==== cluster Cluster_2
initial_a = ClusterInput()
initial_a_2 = Number(initial_a)
cluster = Cluster(X=initial_a_2, Z=0)  # -> pt_6, pt_4, pt_5

# ---- group: CONFIG : START
pt = Point(cluster.pt_6)
pt_2 = Point(cluster.pt_5)
pl = ConstructPlane(Origin=pt, XAxis=expr("{0,0,1}", Vector(78.26149335, 0, 0)), YAxis=expr("{0,-1,0}", Vector(0, 1, 0)))
pl_2 = ConstructPlane(Origin=pt_2, XAxis=expr("{0,0,1}", Vector(78.26149335, 0, 0)), YAxis=expr("{0,-1,0}", Vector(0, 1, 0)))

# ----
mframe = Frame(pl_2)
mframe_2 = Frame(pl)
fe = ClusterOutput(mframe)
fs = ClusterOutput(mframe_2)

# ==== cluster Cluster
X = ClusterInput()
Z = ClusterInput()
pt = ConstructPoint(XCoordinate=expr("x/2", X), YCoordinate=0, ZCoordinate=0)
pt_2 = ConstructPoint(XCoordinate=expr("-x/2", X), YCoordinate=0, ZCoordinate=0)
pt_3 = ConstructPoint(XCoordinate=0, YCoordinate=0, ZCoordinate=Z)
pt_4 = ClusterOutput(pt_3)
pt_5 = ClusterOutput(pt)
pt_6 = ClusterOutput(pt_2)
